# Dynamo graph ductToExcel.dyn (Dynamo 2.6.1.8786)

file_path = Filename("Q:\Moseley\21135 - JMU Carrier Library\11_Calcs\Div 23\Pressure Calcs\DuctMiniSchedule.xlsx")
code_block = CodeBlock { "AHU-7"; 64; 1; }
categories = Categories("OST_DuctCurves")
categories_2 = Categories("OST_DuctFitting")
categories_3 = Categories("OST_DuctAccessory")
list_create = List.Create(item0=categories, item1=categories_2, item2=categories_3)
string_from_object = FromObject(object=list_create)
python_script = Python(IN[0]=string_from_object)
# ---------- python_script.python (47 lines) ----------
#Copyright(c) 2017, john pierson
# @60secondrevit, http://sixtysecondrevit.com
#Thanks to Dimitar and Troy Gates for Guidance
#and this blog http://pythoncvc.net/?p=116
#Edited by Sean Page, 12/9/2020 to accept list of categories
import clr
import msvcrt

clr.AddReference("RevitAPIUI")
from  Autodesk.Revit.UI import *

clr.AddReference("RevitServices")
import RevitServices
from RevitServices.Persistence import DocumentManager
doc = DocumentManager.Instance.CurrentDBDocument
uidoc=DocumentManager.Instance.CurrentUIApplication.ActiveUIDocument

clr.AddReference("RevitNodes")
import Revit
clr.ImportExtensions(Revit.Elements)
TaskDialog.Show('Isolated Selection','Pick elements in desired order, then press ESC to finish')
sel1 = uidoc.Selection
obt1 = Selection.ObjectType.Element

class CustomISelectionFilter(Selection.ISelectionFilter):
	def __init__(self, nom_categorie):
		self.nom_categorie = nom_categorie
	def AllowElement(self, e):
		if self.nom_categorie.Contains(e.Category.Name):
		#if e.Category.Name == self.nom_categorie:
			return True
		else:
			return False
	def AllowReference(self, ref, point):
		return true
msg1 = 'Pick elements in desired order then press ESC to finish.'
out1 = []
flag = True

while flag:
	try:
		el1 = doc.GetElement(sel1.PickObject(obt1,CustomISelectionFilter(IN[0]), msg1).ElementId)
		out1.append(el1.ToDSType(True))
	except:
		flag = False
		
		OUT = out1
# ----------------------------------------
code_block_2 = CodeBlock(elements=python_script) { elements; }
code_block_3 = CodeBlock { "Width"; }
getParameterValueByName = Element.GetParameterValueByName(element=code_block_2, parameterName=code_block_3)
code_block_4 = CodeBlock { "Height"; }
getParameterValueByName_2 = Element.GetParameterValueByName(element=code_block_2, parameterName=code_block_4)
code_block_5 = CodeBlock { "Diameter"; }
getParameterValueByName_3 = Element.GetParameterValueByName(element=code_block_2, parameterName=code_block_5)
code_block_6 = CodeBlock { "Length"; }
getParameterValueByName_4 = Element.GetParameterValueByName(element=code_block_2, parameterName=code_block_6)
code_block_7 = CodeBlock { "Flow"; }
getParameterValueByName_5 = Element.GetParameterValueByName(element=code_block_2, parameterName=code_block_7)
name = Family.Name(family=code_block_2)
python_script_2 = Python(IN[0]=getParameterValueByName, IN[1]=getParameterValueByName_2, IN[2]=getParameterValueByName_3, IN[3]=getParameterValueByName_4, IN[4]=getParameterValueByName_5, IN[5]=name)
# ---------- python_script_2.python (8 lines) ----------
outputList = []
if type(IN[0]) == list:
	for i in range(0, len(IN[0])):
		outputList.append([IN[0][i], IN[1][i], IN[2][i], IN[3][i], IN[4][i], IN[5][i]])
else:
	outputList.append([IN[0], IN[1], IN[2], IN[3], IN[4], IN[5]])

OUT = outputList
# ----------------------------------------
exportExcel = Data.ExportExcel(filePath=file_path, sheetName=code_block.out0, startRow=code_block.out1, startCol=code_block.out2, data=python_script_2)
code_block_8 = CodeBlock()
# ---------- code_block_8.designscript (4 lines) ----------
//startRow is indexed from 0
//so take Excel Row - 1

// same thing with startCol
# ----------------------------------------
